vi "Main.gviweb"   [LabVIEW NXG 2.1.0]
panel controls:
  "update tags": bool
panel indicators:
  "Output": error
  "Data Grid": T1[]
  "state": string
  "Array": T2[]
types:
  T1 = cluster{"Element 1": string, "Element 2": i32, "Element 3": f64}
  T2 = cluster{"test machine": string, "test staus": string, "test step": string, "pass indicator": bool, "fail-indicator": bool}
uses:
  NI::Skyline::Configuration::Open Configuration API Key.gvi
  common::check-for-errors.gvi
  NI::Skyline::TagHTTP::Query Tags.gvi
  common::open-from-query-results.gvi
  NI::Skyline::TagHTTP::Read Tag (I32).gvi
  NI::Skyline::TagHTTP::Read Tag (DBL).gvi
  NI::Skyline::TagHTTP::Read Tag (String).gvi
  NI::Skyline::TagHTTP::Read Tag Settings.gvi
diagram:
  w1 = "init"  # query-statemachine-states
  s1 = uninitialised  # shift register
  s2 = uninitialised  # shift register
  s3 = w1  # shift register
  s4 = uninitialised  # shift register
  while {
    Wait(time to wait=50)
    Format Into String(s3) -> w2
    $state <- w2
    # config
    # tags
    case (s3) {
      frame "init", Default {
        disable {
          frame Disabled { }
          frame Enabled {
            w7 = "https://api.systemlinkcloud.com"
            w8 = "aR1FfRtwtREAKnWAfp4sqwCiCxWCve82km5jf-VZgE"
          }
        }
        call "Open Configuration API Key.gvi"(server url=w7, api key=w8) -> (configuration=w3, error out=w9)
        call "check-for-errors.gvi"(Error In=w9, query-statemachine-states="query") -> (Error Out=w4, query-statemachine-states_2=w6)
        w5 = s4
      }
      frame "query" {
        call "Query Tags.gvi"(paths=["cloud.2018springhackathon.*"], error in=s2, configuration=s1) -> (tags=w5, error out=w10)
        call "check-for-errors.gvi"(Error In=w10, query-statemachine-states="open tags") -> (Error Out=w4, query-statemachine-states_2=w6)
        w3 = s1
      }
      frame "open tags" {
        call "open-from-query-results.gvi"(Input_2=s4, Input=s2) -> (element_2=w5, error in=w11)
        call "check-for-errors.gvi"(Error In=w11, query-statemachine-states="read-write") -> (Error Out=w4, query-statemachine-states_2=w6)
        w3 = s1
      }
      frame "handle errors" {
        call "check-for-errors.gvi"(Error In=s2, query-statemachine-states="read-write") -> (Error Out=w4, query-statemachine-states_2=w6)
        $Output <- s2
        w3 = s1
        w5 = s4
      }
      frame "read-write" {
        for {
          w12 = each element of s4
          Property Node(instance in=w12) -> ("Path"=w15, "Datatype"=w16)
          case (w16) {
            frame "Integer" {
              call "Read Tag (I32).gvi"(tag in=w12, error in=s2) -> (value=w19, error out=w17)
              w18 = default
              w20 = default
              w21 = default
            }
            frame "Double", Default {
              call "Read Tag (DBL).gvi"(tag in=w12, error in=s2) -> (value=w20, error out=w17)
              w18 = default
              w19 = default
              w21 = default
            }
            frame "String" {
              call "Read Tag (String).gvi"(tag in=w12, error in=s2) -> (tag out=w22, value=w18, error out=w23)
              case (w18) {
                frame "Running", Default {
                  w24 = FALSE
                  w25 = FALSE
                }
                frame "Fail" {
                  w24 = FALSE
                  w25 = TRUE
                }
                frame "Passed" {
                  w24 = TRUE
                  w25 = FALSE
                }
              }
              call "Read Tag Settings.gvi"(tag in=w22, error in=w23) -> (properties=w26, error out=w17)
              Array Index(array=w26) -> (out0[_]=w27)
              Property Node(instance in=w27) -> ("value"=w28)
              Property Node(instance in=T2 {all zero or empty}, "test machine"=w15, "test staus"=w18, "test step"=w28, "pass indicator"=w24, "fail-indicator"=w25) -> (instance out=w21)
              w19 = default
              w20 = default
            }
          }
          Build Cluster(w18, w19, w20) -> w29
          append w29 to w13
          append w21 to w14
        }
        $"Data Grid" <- w13
        Select(s=$"update tags", t="query", f="read-write") -> w30
        call "check-for-errors.gvi"(Error In=w17, query-statemachine-states=w30) -> (Error Out=w4, query-statemachine-states_2=w6)
        $Array <- w14
        w3 = s1
        w5 = s4
      }
    }
    next s1 = w3
    next s2 = w4
    next s3 = w6
    next s4 = w5
    stop if FALSE
  }
