vi "open-from-query-results.gvi"   [LabVIEW NXG 2.1.0]
inputs:
  "Input_2": "Tag.gtype"[]
  "Input": error
outputs:
  "element_2": "Tag.gtype"[]
  "error in": error
types:
  "DataType.gtype" = enum{"Double", "Integer", "String"}
  "Client Handle.gtype" = u32
  "Configuration.gtype" = cluster{"Server URL": string, "Session": "Client Handle.gtype"}
  "Tag.gtype" = cluster{"Path": string, "Datatype": "DataType.gtype", "Configuration": "Configuration.gtype"}
uses:
  NI::Skyline::TagHTTP::Open Tag.gvi
diagram:
  for {
    w1 = each element of $Input_2
    Property Node(instance in=w1) -> ("Configuration"=w3, "Path"=w4, "Datatype"=w5)
    case (w5) {
      frame "Double", Default {
        call "Open Tag.gvi"(path=w4, data type=w5, error in=$Input, configuration=w3) -> (tag out=w6, error out=w7)
      }
      frame "Integer" {
        call "Open Tag.gvi"(path=w4, data type=w5, error in=$Input, configuration=w3) -> (tag out=w6, error out=w7)
      }
      frame "String" {
        call "Open Tag.gvi"(path=w4, data type=w5, error in=$Input, configuration=w3) -> (tag out=w6, error out=w7)
      }
    }
    append w6 to w2
  }
  $element_2 <- w2
  $"error in" <- w7
