vi "Main.gvi"   [LabVIEW NXG 2.1.0]
panel controls:
  "clear-errors": bool
panel indicators:
  "Output": error
  "tags": T2[]
  "Output_2": error
  "element": "Tag.gtype"[]
  "value": f64
types:
  "DataType.gtype" = enum{"Double", "Integer", "String"}
  "Client Handle.gtype" = u32
  T1 = cluster{"Server URL": string, "Session": "Client Handle.gtype"}
  T2 = cluster{"Path": string, "Datatype": "DataType.gtype", "Configuration": T1}
  "Configuration.gtype" = cluster{"Server URL": string, "Session": "Client Handle.gtype"}
  "Tag.gtype" = cluster{"Path": string, "Datatype": "DataType.gtype", "Configuration": "Configuration.gtype"}
uses:
  NI::Skyline::Configuration::Open Configuration API Key (Desktop).gvi
  NI::Skyline::Configuration::Open Configuration (Desktop).gvi
  common::check-for-errors.gvi
  NI::Skyline::TagHTTP::Query Tags.gvi
  common::open-from-query-results.gvi
  NI::Skyline::TagHTTP::Read Tag (I32).gvi
  NI::Skyline::TagHTTP::Write Tag (I32).gvi
  NI::Skyline::TagHTTP::Read Tag (DBL).gvi
  NI::Skyline::TagHTTP::Write Tag (DBL).gvi
  NI::Skyline::TagHTTP::Read Tag (String).gvi
  NI::Skyline::TagHTTP::Write Tag (String).gvi
  NI::Skyline::TagHTTP::Read Tag Settings.gvi
  NI::Skyline::TagHTTP::Write Tag Settings.gvi
  NI::Skyline::TagHTTP::Open Tag.gvi
diagram:
  disable {
    frame Disabled {
      call "Open Configuration API Key (Desktop).gvi"(server url="https://api.systemlinkcloud.com", api key="aR1FfRtwtREAKnWAfp4sqwCiCxWCve82km5jf-VZgE") -> (configuration=w2, error out=w1)
    }
    frame Enabled {
      call "Open Configuration (Desktop).gvi"(server url="http://hack-g.amer.corp.natinst.com", username="admin", password="hack-g") -> (configuration=w2, error out=w1)
    }
  }
  w3 = "init"  # query-statemachine-states
  Obtain Queue(element data type="Tag.gtype"[] [], error in=w1) -> (error out=w4, queue out=w5)
  s1 = w3  # shift register
  s2 = w4  # shift register
  s3 = uninitialised  # shift register
  while {
    Wait(time to wait=1000)
    case (s1) {
      frame "init", Default {
        call "check-for-errors.gvi"(Error In=s2, query-statemachine-states="query") -> (Error Out=w7, query-statemachine-states_2=w6)
        w8 = s3
      }
      frame "query" {
        call "Query Tags.gvi"(paths=["2018springhackathon.*"], error in=s2, configuration=w2) -> (tags=w8, error out=w9)
        $tags <- w8
        w10 = "wait"  # query-statemachine-states
        w11 = "open tags"  # query-statemachine-states
        Is Equal[ComparisonMode=CompareAggregates](x=s3, y=w8) -> w12
        Select(s=w12, t=w10, f=w11) -> w13
        call "check-for-errors.gvi"(Error In=w9, query-statemachine-states=w13) -> (Error Out=w7, query-statemachine-states_2=w6)
      }
      frame "open tags" {
        call "open-from-query-results.gvi"(Input_2=s3, Input=s2) -> (element_2=w14, error in=w15)
        Enqueue Element(element=w14, error in=w15, queue=w5) -> (error out=w16)
        call "check-for-errors.gvi"(Error In=w16, query-statemachine-states="wait") -> (Error Out=w7, query-statemachine-states_2=w6)
        w8 = s3
      }
      frame "handle errors" {
        Select(s=$"clear-errors", t=no error, f=s2) -> w17
        call "check-for-errors.gvi"(Error In=w17, query-statemachine-states="wait") -> (Error Out=w7, query-statemachine-states_2=w6)
        $Output <- s2
        w8 = s3
      }
      frame "wait" {
        call "check-for-errors.gvi"(Error In=s2, query-statemachine-states="query") -> (Error Out=w7, query-statemachine-states_2=w6)
        w8 = s3
      }
    }
    next s1 = w6
    next s2 = w7
    next s3 = w8
    stop if FALSE
  }
  s4 = w4  # shift register
  s5 = w3  # shift register
  s6 = uninitialised  # shift register
  s7 = uninitialised  # shift register
  s8 = uninitialised  # shift register
  while {
    # cloud tags
    # cloud tags
    case (s5) {
      frame "init", Default {
        disable {
          frame Enabled {
            call "Open Configuration API Key (Desktop).gvi"(server url="https://api.systemlinkcloud.com", api key="aR1FfRtwtREAKnWAfp4sqwCiCxWCve82km5jf-VZgE", error in=s4) -> (configuration=w21, error out=w23)
          }
          frame Disabled {
            call "Open Configuration (Desktop).gvi"(error in=s4) -> (error out=w23)
          }
        }
        call "check-for-errors.gvi"(Error In=w23, query-statemachine-states="update-tag-list") -> (Error Out=w18, query-statemachine-states_2=w19)
        w20 = s6
        w22 = s8
      }
      frame "handle errors" {
        $Output_2 <- s4
        Select(s=$"clear-errors", t=no error, f=s4) -> w24
        call "check-for-errors.gvi"(Error In=w24, query-statemachine-states="update-tag-list") -> (Error Out=w18, query-statemachine-states_2=w19)
        w20 = s6
        w21 = s7
        w22 = s8
      }
      frame "read-write" {
        for {
          w25 = each element of s6
          w26 = each element of s8
          Property Node(instance in=w25) -> ("Datatype"=w27)
          case (w27) {
            frame "Integer" {
              call "Read Tag (I32).gvi"(tag in=w25, error in=s4) -> (value=w29, error out=w30)
              call "Write Tag (I32).gvi"(tag in=w26, value=w29, error in=w30) -> (error out=w28)
            }
            frame "Double", Default {
              call "Read Tag (DBL).gvi"(tag in=w25, error in=s4) -> (value=w31, error out=w32)
              $value <- w31
              call "Write Tag (DBL).gvi"(tag in=w26, value=w31, error in=w32) -> (error out=w28)
            }
            frame "String" {
              call "Read Tag (String).gvi"(tag in=w25, error in=s4) -> (value=w33, error out=w34)
              call "Write Tag (String).gvi"(tag in=w26, value=w33, error in=w34) -> (error out=w35)
              call "Read Tag Settings.gvi"(tag in=w25, error in=s4) -> (tag out=w36, properties=w37, keywords=w38, error out=w39)
              call "Write Tag Settings.gvi"(tag in=w36, properties=w37, keywords=w38, error in=w39) -> (error out=w40)
              Merge Errors(w35, w40) -> (error out=w28)
            }
          }
        }
        call "check-for-errors.gvi"(Error In=w28, query-statemachine-states="update-tag-list") -> (Error Out=w18, query-statemachine-states_2=w19)
        w20 = s6
        w21 = s7
        w22 = s8
      }
      frame "update-tag-list" {
        Dequeue Element(error in=s4, queue=w5, timeout in ms=100) -> (element=w41, error out=w42, timed out?=w43)
        Select(s=w43, t=s6, f=w41) -> w20
        case (w43) {
          frame False, Default {
            for {
              w45 = each element of w20
              Property Node(instance in=w45) -> ("Path"=w46, "Datatype"=w47)
              Concatenate Strings("cloud.", w46) -> w48
              call "Open Tag.gvi"(path=w48, data type=w47, error in=w42, configuration=s7) -> (tag out=w49, error out=w44)
              append w49 to w22
            }
          }
          frame True {
            w44 = w42
            w22 = s8
          }
        }
        call "check-for-errors.gvi"(Error In=w44, query-statemachine-states="read-write") -> (Error Out=w18, query-statemachine-states_2=w19)
        $element <- w20
        w21 = s7
      }
    }
    next s4 = w18
    next s5 = w19
    next s6 = w20
    next s7 = w21
    next s8 = w22
    stop if FALSE
  }
