vi "Main.gviweb"   [LabVIEW NXG 2.1.0]
uses:
  NI::Skyline::TagHTTP::Open Tag.gvi
  NI::Skyline::Configuration::Open Configuration API Key.gvi
diagram:
  while {
    case (_) {
      frame False, Default { }
      frame True {
        call "Open Tag.gvi"()
      }
    }
    Wait(time to wait=50)
    stop if FALSE
  }
  call "Open Configuration API Key.gvi"(server url="https://api.systemlinkcloud.com", api key="aR1FfRtwtREAKnWAfp4sqwCiCxWCve82km5jf-VZgE")
